# Grasshopper definition driverless_LIM_prototype.gh (Grasshopper 1.0.7)

# https://github.com/richieBao/driverlessCity_LIM
file_path = FilePath("C:\Users\richi\omen-richiebao_s\omen_github\driverlessCity_LIM\database\driverlesscity_sqlit.db")

# ----
# OSM
panel = Panel("node")
sql_read = SQLRead(database_sql=file_path, table=panel)  # -> out, output
# ---------- sql_read: Python ----------
"""Read SQL table.
    Inputs:
        database_sql: SQL database file path
        table: Specify a table
    Output:
        output: table content"""

__author__ = "Richie Bao-Chicago.IIT(driverless city project)"
__version__ = "2020.11.30"

ghenv.Component.Name = 'SQL read'
ghenv.Component.NickName = 'SQL read'
ghenv.Component.Message = '0.0.1'
ghenv.Component.Category = 'driverless-city'
ghenv.Component.SubCategory = '0 :: SQL'
ghenv.Component.AdditionalHelpFromDocStrings = '5'

import rhinoscriptsyntax as rs
import sqlite3
import ghpythonlib.treehelpers as th
import Rhino

conn=sqlite3.connect(database_sql)
with conn:
    cur = conn.cursor()
    cur.execute("SELECT * FROM %s"%table)
    rows = cur.fetchall()


layerTree = th.list_to_tree(rows, source=[0,])
output=layerTree
# ---------- end sql_read ----------
panel_2 = Panel(sql_read.output)
sql_read_2 = SQLRead(database_sql=file_path, table="way")  # -> out, output; same code as sql_read
way2pts = WayToPoints(sql_data=sql_read_2.output, field="tags")  # -> out, out_by_field; inputs sql_data: tree
# ---------- way2pts: Python ----------
"""Read SQL table.
    Inputs:
        sql_data: SQL data readed
        field: data field ready to handle
    Output:
        out_by_field: export data by the field specified"""

__author__ = "Richie Bao-Chicago.IIT(driverless city project)"
__version__ = "2020.12.09"

ghenv.Component.Name = 'way to points'
ghenv.Component.NickName = 'way2pts'
ghenv.Component.Message = '0.0.1'
ghenv.Component.Category = 'driverless-city'
ghenv.Component.SubCategory = '0 :: SQL'
ghenv.Component.AdditionalHelpFromDocStrings = '5'

import rhinoscriptsyntax as rs
import sqlite3
import ghpythonlib.treehelpers as th
import Rhino

data=th.tree_to_list(sql_data)

if field=='geometry':   
    x=[[v[0] for v in eval(d[2])] for d in data]
    y=[[v[1] for v in eval(d[2])] for d in data]
    
    out_by_field=th.list_to_tree([x,y],source=[0,0])
    
    
    
    
if field=='tags':
    tags=[d[11] for d in data]
    out_by_field=tags
# ---------- end way2pts ----------
way2pts_2 = WayToPoints(sql_data=sql_read_2.output, field="geometry")  # -> out, out_by_field, X, Y; inputs sql_data: tree
# ---------- way2pts_2: Python ----------
"""Read SQL table.
    Inputs:
        sql_data: SQL data readed
        field: data field ready to handle
    Output:
        out_by_field: export data by the field specified"""

__author__ = "Richie Bao-Chicago.IIT(driverless city project)"
__version__ = "2020.12.09"

ghenv.Component.Name = 'way to points'
ghenv.Component.NickName = 'way2pts'
ghenv.Component.Message = '0.0.1'
ghenv.Component.Category = 'driverless-city'
ghenv.Component.SubCategory = '0 :: SQL'
ghenv.Component.AdditionalHelpFromDocStrings = '5'

import rhinoscriptsyntax as rs
import sqlite3
import ghpythonlib.treehelpers as th
import Rhino

data=th.tree_to_list(sql_data)

if field=='geometry':   
    x=[[v[0] for v in eval(d[2])] for d in data]
    y=[[v[1] for v in eval(d[2])] for d in data]
    
    X=th.list_to_tree(x,source=[0,0])
    Y=th.list_to_tree(y,source=[0,0])
    
    
    
    
if field=='tags':
    tags=[d[11] for d in data]
    out_by_field=tags
# ---------- end way2pts_2 ----------
point = Point(Point(18.18028534, -4.825244709, 0))
coordi2pts = CoordinatesStringToPoints(sql_data=sql_read.output, field="geometry")  # -> out, out_by_field; inputs sql_data: tree
# ---------- coordi2pts: Python ----------
"""Read SQL table.
    Inputs:
        sql_data: SQL data readed
        field: data field ready to handle
    Output:
        out_by_field: export data by the field specified"""

__author__ = "Richie Bao-Chicago.IIT(driverless city project)"
__version__ = "2020.12.09"

ghenv.Component.Name = 'coordinates string to points'
ghenv.Component.NickName = 'coordi2pts'
ghenv.Component.Message = '0.0.1'
ghenv.Component.Category = 'driverless-city'
ghenv.Component.SubCategory = '0 :: SQL'
ghenv.Component.AdditionalHelpFromDocStrings = '5'

import rhinoscriptsyntax as rs
import sqlite3
import ghpythonlib.treehelpers as th
import Rhino

data=th.tree_to_list(sql_data)

if field=='geometry':    
    x=[eval(d[2])[0] for d in data]
    y=[eval(d[2])[1] for d in data]
    
    out_by_field=th.list_to_tree([x,y],source=[0,0])
    
if field=='tags':
    tags=[d[11] for d in data]
    out_by_field=tags
# ---------- end coordi2pts ----------
coordi2pts_2 = CoordinatesStringToPoints(sql_data=sql_read.output, field="tags")  # -> out, out_by_field; inputs sql_data: tree; same code as coordi2pts
tags2group = TagsGroup(tags=way2pts.out_by_field, tag_given="building")  # -> out, tags_bool; inputs tags: list
# ---------- tags2group: Python ----------
"""Processing the tags of OSM.
    Inputs:
        tags: tags string
        field: data field ready to handle
    Output:
        labels: all of the tags name
        tags_bool: 
            """

__author__ = "Richie Bao-Chicago.IIT(driverless city project)"
__version__ = "2020.12.09"

ghenv.Component.Name = 'tags group'
ghenv.Component.NickName = 'tags2group'
ghenv.Component.Message = '0.0.1'
ghenv.Component.Category = 'driverless-city'
ghenv.Component.SubCategory = '0 :: SQL'
ghenv.Component.AdditionalHelpFromDocStrings = '5'

import rhinoscriptsyntax as rs
import sqlite3
import ghpythonlib.treehelpers as th
import Rhino

tag_b=[]
if tag_given is not None:
    for row in tags:
        #print(eval(row).keys())
        if tag_given in eval(row).keys():
            tag_b.append(1)
        else:
            tag_b.append(0)


tags_bool=tag_b
# ---------- end tags2group ----------
construct_point = ConstructPoint(XCoordinate=way2pts_2.X, YCoordinate=way2pts_2.Y, ZCoordinate=0)
param_viewer = ParamViewer(way2pts.out_by_field)
rectangle = Rectangle(Plane=point, XSize=Slider(9.317, range=0..50), YSize=Slider(22.917, range=0..50), Radius=0)  # -> Rectangle, Length
unit_z = UnitZ(Factor=Slider(8.184, range=0..50))
locating = Point(Point(448005.0733, 4631643.318, 0))
match_text = MatchText(Text=coordi2pts_2.out_by_field, Pattern="{}", Case=True)
locating_2 = Point(Point(448031.7195, 4631708.776, 0))
flip_matrix = FlipMatrix(Data=coordi2pts.out_by_field)
polyline = PolyLine(Vertices=construct_point, Closed=False)
extrude = Extrude(Base=rectangle.Rectangle, Direction=unit_z)
closest_obj_ikx = ClosestObjecIndx(objs=flatten(polyline), point=locating)  # -> out, closest_obj, obj_idx, closest_point; inputs objs: list
# ---------- closest_obj_ikx: Python ----------
"""find the nearest obj index.
    Inputs:
        objs: objects list
        point: a point used to find the nearest object
    Output:
        closest_obj: the closest object
        obj_idx: the closest object index
        closest_point:the nereast point projecting to the closest object
            """

__author__ = "Richie Bao-Chicago.IIT(driverless city project)"
__version__ = "2020.12.09"

ghenv.Component.Name = 'closest objec indx'
ghenv.Component.NickName = 'closest obj Ikx'
ghenv.Component.Message = '0.0.1'
ghenv.Component.Category = 'driverless-city'
ghenv.Component.SubCategory = '0 :: SQL'
ghenv.Component.AdditionalHelpFromDocStrings = '5'

import rhinoscriptsyntax as rs
import sqlite3
import ghpythonlib.treehelpers as th
import Rhino

results=rs.PointClosestObject(point,objs)
if results:
    obj=results[0]
    closest_point=results[1]

    idx=0
    for o in objs:
        if o==obj:
            obj_idx=idx
        idx+=1

closest_obj=obj
# ---------- end closest_obj_ikx ----------
cull_pattern = CullPattern(List=flatten(polyline), CullPattern=flatten(tags2group.tags_bool))
gate_not = GateNot(A=match_text)
numbers_to_points = NumbersToPoints(Numbers=flip_matrix, Mask=2)
closest_point = ClosestPoint(Point=locating_2, Cloud=flatten(numbers_to_points))  # -> ClosestPoint, CPIndex, Distance
list_item = ListItem(List=coordi2pts_2.out_by_field, Index=closest_point.CPIndex, Wrap=True)
cap_holes = CapHoles(Brep=extrude)
list_item_2 = ListItem(List=flatten(numbers_to_points), Index=closest_point.CPIndex, Wrap=True)
panel_3 = Panel(closest_obj_ikx.obj_idx)
panel_4 = Panel(polyline)
colour_swatch = ColourSwatch(SwatchColor=RGB(255, 0, 0))
custom_preview = CustomPreview(Geometry=closest_obj_ikx.closest_obj, Material=ColourSwatch(SwatchColor=RGB(255, 0, 208)))
cull_pattern_2 = CullPattern(List=flatten(numbers_to_points), CullPattern=gate_not)
panel_5 = Panel(cap_holes)
custom_preview_2 = CustomPreview(Geometry=cull_pattern, Material=ColourSwatch(SwatchColor=RGB(255, 255, 255)))
list_item_3 = ListItem(List=way2pts.out_by_field, Index=closest_obj_ikx.obj_idx, Wrap=True)
param_viewer_2 = ParamViewer(polyline)
dot_display = DotDisplay(Point=list_item_2, Colour=colour_swatch, Size=Slider(4.052, range=0..20))
text_tag_3d = TextTag3D(Location=list_item_2, Text=list_item, Size=Slider(4.052, range=0..20), Colour=colour_swatch, Justification=7)
dot_display_2 = DotDisplay(Point=flatten(cull_pattern_2), Colour=RGB(0, 0, 0), Size=Slider(2.122, range=0..20))
text_tag = TextTag(Location=list_item_2, Text=list_item, Colour=colour_swatch)
text = Text()
text_tag_3d_2 = TextTag3D(Location=locating, Text=list_item_3, Size=Slider(4.052, range=0..20), Colour=colour_swatch, Justification=7)
panel_6 = Panel(match_text)
panel_7 = Panel(list_item_2)

# ----
# landmarks and PHMI
number_slider = Slider(10, range=0..100)
point_2 = Point([Point(17.43733602, -10.50332197, 0), Point(14.66925011, -20.24288349, 0), Point(22.05081253, -36.44131212, 0), Point(13.74655481, -49.56408974, 0), Point(21.84576913, -60.94399847, 0), Point(19.59029172, -65.86504008, 0), Point(20.20542192, -79.1928611, 0)])
sql_read_3 = SQLRead(database_sql=file_path, table="table_location_phmi")  # -> out, output; same code as sql_read
sql_read_4 = SQLRead(database_sql=file_path, table="table_landmark")  # -> out, output; same code as sql_read
pts_attri = PointsAttribute(points=point_2, attribute=number_slider)  # -> out, pts_attri; inputs points: list
# ---------- pts_attri: Python ----------
"""Provides a scripting component.
    Inputs:
        points: Specify some points with an attribute
        attribute: Configure points' attribute
    Output:
        pts_attri: points given with certian attribute"""

__author__ = "Richie Bao-Chicago.IIT(driverless city project)"
__version__ = "2020.11.30"

ghenv.Component.Name = 'points attribute'
ghenv.Component.NickName = 'pts attri'
ghenv.Component.Message = '0.0.1'
ghenv.Component.Category = 'driverless-city'
ghenv.Component.SubCategory = '1 :: SQL'
ghenv.Component.AdditionalHelpFromDocStrings = '5'

import rhinoscriptsyntax as rs
import ghpythonlib.treehelpers as th
pts_coordi=[[c for c in rs.PointCoordinates(pt)]+[attribute] for pt in points]
pts_attri=th.list_to_tree(pts_coordi, source=[0,])
# ---------- end pts_attri ----------
panel_8 = Panel("""x
y
z
attribute""")
list_item_4 = ListItem(List=sql_read_3.output, Index="1", Wrap=True)  # -> flatten(Item)
list_item_5 = ListItem(List=sql_read_3.output, Index="2", Wrap=True)  # -> flatten(Item)
list_item_6 = ListItem(List=sql_read_4.output, Index="1", Wrap=True)  # -> flatten(Item)
list_item_7 = ListItem(List=sql_read_4.output, Index="2", Wrap=True)  # -> flatten(Item)
sql_dump = SQLDump(database_sql=file_path, pts_attri=pts_attri.pts_attri, field=panel_8, table_name="pts_attri")  # -> out, prompt; inputs pts_attri: tree, field: list
# ---------- sql_dump: Python ----------
__author__ = "Richie Bao-Chicago.IIT(driverless city project)"
__version__ = "2020.11.30"

ghenv.Component.Name = 'SQL dump'
ghenv.Component.NickName = 'SQL dump'
ghenv.Component.Message = '0.0.1'
ghenv.Component.Category = 'driverless-city'
ghenv.Component.SubCategory = '1 :: SQL'
ghenv.Component.AdditionalHelpFromDocStrings = '5'

import rhinoscriptsyntax as rs
import rhinoscriptsyntax as rs
import sqlite3
import ghpythonlib.treehelpers as th
import Rhino

def create_table(conn, create_table_sql):
    """ create a table from the create_table_sql statement
    :param conn: Connection object
    :param create_table_sql: a CREATE TABLE statement
    :return:
    """
    try:
        c = conn.cursor()
        c.execute(create_table_sql)
    except Error as e:
        print(e)
        
def data2sqlite(conn,table_name,data):
    with conn:
        conn.executemany("insert into %s(x, y,z,attribute) values (?,?,?,?)"%table_name,data)
        conn.commit()
        
        
        

pts_attri_nested_list=th.tree_to_list(pts_attri)

conn=sqlite3.connect(database_sql)
sql_create_table = """CREATE TABLE IF NOT EXISTS %s (
                                id integer PRIMARY KEY AUTOINCREMENT,
                                %s real NOT NULL,
                                %s real NOT NULL,
                                %s real NOT NULL,
                                %s real NOT NULL

                            );"""%(table_name,field[0],field[1],field[2],field[3])

create_table(conn, sql_create_table)

data2sqlite(conn,table_name,pts_attri_nested_list)
prompt="dumpped the data!"
# ---------- end sql_dump ----------
construct_point_2 = ConstructPoint(XCoordinate=list_item_6, YCoordinate=list_item_7, ZCoordinate=0)
construct_point_3 = ConstructPoint(XCoordinate=list_item_4, YCoordinate=list_item_5, ZCoordinate=0)
panel_9 = Panel(pts_attri.pts_attri)
panel_10 = Panel(sql_dump.prompt)
panel_11 = Panel(sql_read_4.output)

# ----
# 3D building
panel_12 = Panel("building_3d")
sql_read_5 = SQLRead(database_sql=file_path, table=panel_12)  # -> out, output; same code as sql_read
_3d_building = _3DBuilding(sql_data=sql_read_5.output)  # -> out, X, Y, height, properties; inputs sql_data: tree
# ---------- _3d_building: Python ----------
"""Read SQL table.
    Inputs:
        sql_data: SQL data readed 
        
    Output:
        X: building points Coordinate-x
        Y: building points Coordinate-y
        height:building height     
        properties: building properties
        """

__author__ = "Richie Bao-Chicago.IIT(driverless city project)"
__version__ = "2021.01.13"

ghenv.Component.Name = '3D building'
ghenv.Component.NickName = '3D building'
ghenv.Component.Message = '0.0.1'
ghenv.Component.Category = 'driverless-city'
ghenv.Component.SubCategory = '0 :: SQL'
ghenv.Component.AdditionalHelpFromDocStrings = '5'

import rhinoscriptsyntax as rs
import sqlite3
import ghpythonlib.treehelpers as th
import Rhino

data=th.tree_to_list(sql_data)


x=[[v[0] for v in eval(d[4])] for d in data]
y=[[v[1] for v in eval(d[4])] for d in data]
    
X=th.list_to_tree(x,source=[0,0])
Y=th.list_to_tree(y,source=[0,0])
height=[d[6] for d in data]
properties=[d[3] for d in data]
# ---------- end _3d_building ----------
panel_13 = Panel(_3d_building.properties)
panel_14 = Panel(_3d_building.Y)
construct_point_4 = ConstructPoint(XCoordinate=_3d_building.X, YCoordinate=_3d_building.Y, ZCoordinate=0)
panel_15 = Panel(_3d_building.X)
panel_16 = Panel(_3d_building.height)
polyline_2 = PolyLine(Vertices=construct_point_4, Closed=False)
unit_z_2 = UnitZ(Factor=_3d_building.height)
boundary_surfaces = BoundarySurfaces(Edges=polyline_2)
extrude_2 = Extrude(Base=flatten(boundary_surfaces), Direction=unit_z_2)
param_viewer_3 = ParamViewer(_3d_building.height)
locating_3 = Point(Point(447835.8587, 4631514.271, 0))
closest_obj_ikx_2 = ClosestObjecIndx(objs=flatten(polyline_2), point=locating_3)  # -> out, closest_obj, obj_idx, closest_point; inputs objs: list; same code as closest_obj_ikx
list_item_8 = ListItem(List=_3d_building.height, Index=closest_obj_ikx_2.obj_idx, Wrap=True)
unit_z_3 = UnitZ(Factor=list_item_8)
move = Move(Geometry=locating_3, Motion=unit_z_3)  # -> Geometry, Transform
list_item_9 = ListItem(List=_3d_building.properties, Index=closest_obj_ikx_2.obj_idx, Wrap=True)
text_tag_3d_3 = TextTag3D(
    Location=move.Geometry,
    Text=list_item_9,
    Size=Slider(4.052, range=0..20),
    Colour=ColourSwatch(SwatchColor=RGB(255, 0, 0)),
    Justification=7)

tags2group_2 = TagsGroup(tags=way2pts.out_by_field, tag_given="highway")  # -> out, tags_bool; inputs tags: list; same code as tags2group
cull_pattern_3 = CullPattern(List=flatten(polyline), CullPattern=flatten(tags2group_2.tags_bool))
custom_preview_3 = CustomPreview(Geometry=cull_pattern_3, Material=ColourSwatch(SwatchColor=RGB(0, 0, 0)))

tags2group_3 = TagsGroup(tags=way2pts.out_by_field, tag_given="sport")  # -> out, tags_bool; inputs tags: list; same code as tags2group
cull_pattern_4 = CullPattern(List=flatten(polyline), CullPattern=flatten(tags2group_3.tags_bool))
custom_preview_4 = CustomPreview(Geometry=cull_pattern_4, Material=ColourSwatch(SwatchColor=RGB(18, 235, 255)))

tags2group_4 = TagsGroup(tags=way2pts.out_by_field, tag_given="amenity")  # -> out, tags_bool; inputs tags: list; same code as tags2group
cull_pattern_5 = CullPattern(List=flatten(polyline), CullPattern=flatten(tags2group_4.tags_bool))
custom_preview_5 = CustomPreview(Geometry=cull_pattern_5, Material=ColourSwatch(SwatchColor=RGB(181, 255, 186)))
